# Grasshopper definition dev_big.ghx (Grasshopper 1.0.7)

# ---- group: Add Module Path
python = GhPythonScript(PATH="C:\Users\yoshioca\Documents\GH_Gcode")  # -> out, a; disabled
# ---------- python: Python ----------
import sys

sys.path.append(PATH)

print(sys.path)
# ---------- end python ----------

# ----
panel = Panel(python.out)
# - Viewer -
panel_2 = Panel("C:\Users\yoshioca\Documents\GH_Gcode\_data_\data_out\2020-04-24_03-05-40.txt")

crv = Curve([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])
# - Polyline to GCode -
crv_2 = Curve(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)

python_2 = GhPythonScript(
    POLYLINES=crv,
    M3_S_VALUE="111",
    M4_S_VALUE="222",
    F_VALUE="333",
    EXPORT=Button(),
    EXPORT_DIR="C:\Users\yoshioca\Documents\GH_Gcode\_data_\data_out\")  # -> out, POINTS; inputs POLYLINES: list
# ---------- python_2: Python ----------
import rhinoscriptsyntax as rs

from gh_gcode import operate_curve, operate_big_gcode, util

gc = operate_curve.Curve()
gg = operate_big_gcode.Gcode()
ut = util.Util()

reload(operate_curve)
reload(operate_big_gcode)
reload(util)


##########


### Polylines to Points
pts = gc.polylines_to_points(POLYLINES)
POINTS = ut.flatten_runtime_list(pts)

### Points to Gcode
gcode = gg.points_list_to_gcode(pts, M3_S_VALUE, M4_S_VALUE, F_VALUE)



if EXPORT == True:
    ut.export_gcode(EXPORT_DIR, gcode)
# ---------- end python_2 ----------
python_3 = GhPythonScript(PATH=panel_2)  # -> out, MOVE
# ---------- python_3: Python ----------
import rhinoscriptsyntax as rs


##################################
###    module for Grasshopper    #
###    Python 2                  #
##################################


class Gcode_for_GH():
    
    
    def open_file(self, path):
        with open(path) as f:
            l = f.readlines()
        # print(type(l))
        # print(len(l))
        # print(l)
        return l
    

    def add_xyz_to_polyline(self, path):

        gcode = self.open_file(path)

        count = 0
        x = []
        y = []
        z = []

        ### init
        x.append(0)
        y.append(0)
        z.append(0)

        # loop = 20
        loop = len(gcode)

        for i in range(loop):

            count += 1
            str_ = gcode[i]
            
            if ("X" in str_):
                ### Split Elements
                elements = str_.split()
                for j in range(len(elements)):
                    e = elements[j]
                    
                    if ("X" in e):
                        tmp_x = e.split("X")
                        x.append(tmp_x[1])
            else:
                tmp_x = x[i]
                x.append(tmp_x)


        for ii in range(loop):

            str_ = gcode[ii]
            
            if ("Y" in str_):
                ### Split Elements
                elements = str_.split()
                for jj in range(len(elements)):
                    e = elements[jj]
                    
                    if ("Y" in e):
                        tmp_y = e.split("Y")
                        y.append(tmp_y[1])
            else:
                tmp_y = y[ii]
                y.append(tmp_y)


        for iii in range(loop):

            str_ = gcode[iii]
            
            if ("Z" in str_):
                ### Split Elements
                elements = str_.split()
                for jjj in range(len(elements)):
                    e = elements[jjj]
                    
                    if ("Z" in e):
                        tmp_z = e.split("Z")
                        z.append(tmp_z[1])
            else:
                tmp_z = z[iii]
                z.append(tmp_z)

        # print("x : {} / {}".format(len(x), x))
        # print("y : {} / {}".format(len(y), y))
        # print("z : {} / {}".format(len(z), z))

        print("Count : {}".format(count))
        
        return x, y, z
    
    
    def zip_matrix(self, mat):
        ### https://note.nkmk.me/python-list-transpose/
        return [list(x) for x in zip(*mat)]



###################################


gg = Gcode_for_GH()


v = gg.add_xyz_to_polyline(PATH)
v_f = gg.zip_matrix(v)

print(len(v_f))
#print(v_f)



MOVE = rs.AddPolyline(v_f)
# ---------- end python_3 ----------
panel_3 = Panel(python_2.out)
pt = Point(python_2.POINTS)
divide = DivideCurve(Curve=python_3.MOVE, Count=1000, Kinks=False)  # -> Points, Tangents, Parameters

# ---- group: Build Plate
python_4 = GhPythonScript()  # -> out, AREA
# ---------- python_4: Python ----------
import rhinoscriptsyntax as rs

AREA = rs.AddRectangle(rs.WorldXYPlane(), 1700, 1300)
# ---------- end python_4 ----------

# ----
item = ListItem(List=divide.Points, Index=Slider(354, range=0..1000), Wrap=True)
preview = CustomPreview(Geometry=python_4.AREA, Material=ColourSwatch(SwatchColor=RGB(187, 255, 255)))
sph = Sphere(Base=item, Radius=5)
